# Grasshopper definition screen.gh (Grasshopper 1.0.4)

number_slider = Slider(1, range=0..1)
number_slider_2 = Slider(1, range=0..1)
number_slider_3 = Slider(2, range=0..10)
division = Division(A=number_slider, B=Slider(2.6, range=0..10))
division_2 = Division(A=number_slider_3, B=Slider(2.1, range=0..10))
cir = Circle(Plane=PlaneXY(0, 0, 0), Radius=division)
series = Series(Start=0, Step=number_slider, Count=Slider(30, range=0..100))
cir_2 = Circle(Plane=PlaneXY(0, 0, 0), Radius=division_2)
series_2 = Series(Start=0, Step=number_slider_3, Count=Slider(15, range=0..100))
Y = UnitY(Factor=series)
X = UnitX(Factor=series)
Y_2 = UnitY(Factor=series_2)
X_2 = UnitX(Factor=series_2)
move = Move(Geometry=cir, Motion=X)  # -> Geometry, Transform
move_2 = Move(Geometry=cir_2, Motion=X_2)  # -> Geometry, Transform
move_3 = Move(Geometry=move.Geometry, Motion=graft(Y))  # -> Geometry, Transform
move_4 = Move(Geometry=move_2.Geometry, Motion=graft(Y_2))  # -> Geometry, Transform
