# Grasshopper definition portico.gh (Grasshopper 1.0.4)

pt = Point(Point(0, 0, 0))
X = UnitX(Factor=Slider(7, range=0..10))
number_slider = Slider(0.25, range=0..1)
move = Move(Geometry=pt, Motion=X)  # -> Geometry, Transform
ln = Line(StartPoint=pt, EndPoint=move.Geometry)
series = Series(Start=0, Step=number_slider, Count=Slider(8, range=0..10))
neg = Negative(Value=series)
division = Division(A=series, B=Slider(2, range=0..10))
Z = UnitZ(Factor=division)
offset = Offset(Curve=ln, Distance=neg, Plane=PlaneXY(0, 0, 0), Corners=1)  # -> flatten(Curve)
Y = UnitY(Factor=number_slider)
move_2 = Move(Geometry=offset, Motion=Z)  # -> Geometry, Transform
move_3 = Move(Geometry=move_2.Geometry, Motion=Y)  # -> Geometry, Transform
