# Grasshopper definition rough.gh (Grasshopper 1.0.4)

number_slider = Slider(1.3, range=0..10)
pt = Point(Point(0, 0, 0))
xy = XYPlane(Origin=pt)
division = Division(A=number_slider, B=Slider(4, range=0..10))
cir = Circle(Plane=xy, Radius=number_slider)
Z = UnitZ(Factor=Slider(0.5, range=0..1))
cir_2 = Circle(Plane=xy, Radius=division)
Z_2 = UnitZ(Factor=Slider(1, range=0..1))
move = Move(Geometry=cir_2, Motion=Z)  # -> Geometry, Transform
move_2 = Move(Geometry=cir_2, Motion=Z_2)  # -> Geometry, Transform
Z_3 = UnitZ(Factor=Slider(3, range=0..10))
series = Series(Start=Slider(0.9, range=0..10), Step=Slider(0.35, range=0..1), Count=Slider(10, range=0..100))
sph = Sphere(Base=pt, Radius=Slider(2, range=0..10))
Z_4 = UnitZ(Factor=series)
sph_2 = Sphere(Base=pt, Radius=Slider(1.9, range=0..10))
move_3 = Move(Geometry=pt, Motion=Z_4)  # -> Geometry, Transform
move_4 = Move(Geometry=sph, Motion=Z_3)  # -> Geometry, Transform
move_5 = Move(Geometry=sph_2, Motion=Z_3)  # -> Geometry, Transform
X = UnitX(Factor=Slider(1.5, range=0..10))
Z_5 = UnitZ(Factor=Slider(0.18, range=0..1))
move_6 = Move(Geometry=move_3.Geometry, Motion=X)  # -> Geometry, Transform
move_7 = Move(Geometry=move_6.Geometry, Motion=Z_5)  # -> Geometry, Transform
srf_cp = SurfaceClosestPoint(Point=move_6.Geometry, Surface=move_4.Geometry)  # -> Point, UVPoint, Distance
iso = IsoCurve(Surface=move_4.Geometry, UVPoint=srf_cp.UVPoint)  # -> UIsocurve, VIsocurve
srf_cp_2 = SurfaceClosestPoint(Point=move_7.Geometry, Surface=move_5.Geometry)  # -> Point, UVPoint, Distance
iso_2 = IsoCurve(Surface=move_5.Geometry, UVPoint=srf_cp_2.UVPoint)  # -> UIsocurve, VIsocurve
crv = Curve(iso.UIsocurve)
crv_2 = Curve(iso_2.UIsocurve)
entwine = Entwine(Branch00=crv, Branch01=crv_2, FlattenInputs=True)  # -> flatten(Result)
merge = Merge(Data1=cir, Data2=move.Geometry, Data3=move_2.Geometry, Data4=entwine)
loft = Loft(Curves=merge, Options={Adjust=False, Closed=False, LoftEnds=0, LoftSimp=0, LoftType=0, Rebuild=10, Refit=0.01})
