# Grasshopper definition shot.gh (Grasshopper 1.0.4)

number_slider = Slider(20, range=0..100)
addition = Addition(A=number_slider, B=Slider(1, range=0..1))
number_slider_2 = Slider(0, range=0..0.1)
pt = Point(Point(0, 0, 0))
division = Division(A=Slider(4, range=0..10), B=number_slider)
series = Series(Start=0, Step=division, Count=addition)
cir = Circle(Plane=pt, Radius=Slider(1.1, range=0..10))
Z = UnitZ(Factor=series)
cir_2 = Circle(Plane=pt, Radius=Slider(0.995, range=0..1))
cir_3 = Circle(Plane=pt, Radius=Slider(0.001, range=0..0.001))
Z_2 = UnitZ(Factor=Slider(0.25, range=0..1))
move = Move(Geometry=cir_2, Motion=Z)  # -> Geometry, Transform
move_2 = Move(Geometry=cir, Motion=Z)  # -> Geometry, Transform
move_3 = Move(Geometry=cir_3, Motion=Z_2)  # -> Geometry, Transform
shift = ShiftList(List=move.Geometry, Shift=Slider(3, range=0..10), Wrap=Toggle(False))
rev = ReverseList(List=shift)
merge = Merge(Data1=move_2.Geometry, Data2=rev, Data3=move_3.Geometry)
loft = Loft(Curves=flatten(merge), Options={Adjust=False, Closed=False, LoftEnds=0, LoftSimp=0, LoftType=0, Rebuild=10, Refit=0.01})
