# Grasshopper definition tree.gh (Grasshopper 1.0.4)

number_slider = Slider(2, range=0..10)
pt = Point(Point(4.643263192, 5.159181324, 0))
cir = Circle(Plane=pt, Radius=Slider(0.75, range=0..1))
Z = UnitZ(Factor=Slider(29, range=0..100))
extr = Extrude(Base=cir, Direction=Z)
move = Move(Geometry=pt, Motion=Z)  # -> Geometry, Transform
number_slider_2 = Slider(6, range=0..10)
multiplication = Multiplication(A=number_slider_2, B=Slider(0.95, range=0..1))
number_slider_3 = Slider(12, range=0..100)
srf = Surface(<surface referenced from the Rhino model>)
number_slider_4 = Slider(20, range=0..100)
Z_2 = UnitZ(Factor=multiplication)
move_2 = Move(Geometry=move.Geometry, Motion=Z_2)  # -> Geometry, Transform
msphere = MeshSphere(Base=move_2.Geometry, Radius=number_slider_2, UCount=number_slider_3, VCount=number_slider_3)
mesh_uv = MeshSurface(Surface=srf, UCount=number_slider_4, VCount=number_slider_4, Overhang=True, Equalize=False)
demesh = DeconstructMesh(Mesh=msphere)  # -> Vertices, Faces, Colours, Normals
del = DelaunayMesh(Points=demesh.Vertices, Plane=PlaneXY(0, 0, 0))
