# Grasshopper definition boxes.gh (Grasshopper 1.0.4)

number_slider = Slider(0.1, range=0..1)
number_slider_2 = Slider(4, range=0..10)
number_slider_3 = Slider(0.5, range=0..1)
number_slider_4 = Slider(2, range=0..10)
number_slider_5 = Slider(1.5, range=0..10)
pt = Point(Point(0, 0, 0))
X = UnitX(Factor=Slider(1, range=0..1))
number_slider_6 = Slider(0.5, range=0..1)
move = Move(Geometry=pt, Motion=X)  # -> Geometry, Transform
rectangle = Rectangle(Plane=move.Geometry, XSize=number_slider, YSize=number_slider, Radius=0)  # -> Rectangle, Length
division = Division(A=number_slider_2, B=number_slider_3)
xy = XYPlane(Origin=pt)
yz = YZPlane(Origin=pt)
cir = Circle(Plane=move.Geometry, Radius=number_slider)
xz = XZPlane(Origin=pt)
round = Round(Number=division)  # -> Nearest, Floor, Ceiling
subtraction = Subtraction(A=round.Floor, B=Slider(1, range=0..1))
series = Series(Start=number_slider_3, Step=number_slider_3, Count=subtraction)
number_slider_7 = Slider(0.1, range=0..0.1)
move_2 = Move(Geometry=pt, Motion=Vector(0, 0, 10))  # -> Geometry, Transform
series_2 = Series(Start=number_slider_6, Step=number_slider_6, Count=Slider(3, range=0..10))
rectangle_2 = Rectangle(Plane=yz, XSize=number_slider_2, YSize=number_slider_5, Radius=0)  # -> Rectangle, Length
rectangle_3 = Rectangle(Plane=pt, XSize=number_slider_4, YSize=number_slider_2, Radius=0)  # -> Rectangle, Length
rectangle_4 = Rectangle(Plane=xz, XSize=number_slider_4, YSize=number_slider_5, Radius=0)  # -> Rectangle, Length
Y = UnitY(Factor=series)
X_2 = UnitX(Factor=Slider(0.5, range=0..1))
move_3 = Move(Geometry=rectangle.Rectangle, Motion=Y)  # -> Geometry, Transform
rectangle_5 = Rectangle(Plane=PlaneXY(0, 0, 0), XSize=number_slider_7, YSize=number_slider_7, Radius=0)  # -> Rectangle, Length
neg = Negative(Value=X_2)
X_3 = UnitX(Factor=series_2)
Y_2 = UnitY(Factor=Slider(0.25, range=0..1))
move_4 = Move(Geometry=move_3.Geometry, Motion=X_2)  # -> Geometry, Transform
move_5 = Move(Geometry=move_2.Geometry, Motion=X_3)  # -> Geometry, Transform
move_6 = Move(Geometry=move_3.Geometry, Motion=neg)  # -> Geometry, Transform
move_7 = Move(Geometry=rectangle_5.Rectangle, Motion=X_3)  # -> Geometry, Transform
neg_2 = Negative(Value=Y_2)
merge = Merge(Data1=move_3.Geometry, Data2=move_4.Geometry, Data3=move_6.Geometry)
boundary = BoundarySurfaces(Edges=rectangle_3.Rectangle)
srfsplit = SurfaceSplit(Surface=boundary, Curves=merge)
move_8 = Move(Geometry=move_5.Geometry, Motion=neg_2)  # -> Geometry, Transform
Y_3 = UnitY(Factor=series)
item = ListItem(List=srfsplit, Index=0, Wrap=True)
shift = ShiftList(List=move_5.Geometry, Shift=1, Wrap=True)
move_9 = Move(Geometry=graft(move_7.Geometry), Motion=Y_3)  # -> Geometry, Transform
boundary_2 = BoundarySurfaces(Edges=rectangle_2.Rectangle)
dispatch = Dispatch(List=move_5.Geometry, DispatchPattern=[True, False])  # -> ListA, ListB
dispatch_2 = Dispatch(List=shift, DispatchPattern=[True, False])  # -> ListA, ListB
boundary_3 = BoundarySurfaces(Edges=rectangle_4.Rectangle)
shift_2 = ShiftList(List=move_8.Geometry, Shift=1, Wrap=True)
X_4 = UnitX(Factor=number_slider_4)
Y_4 = UnitY(Factor=number_slider_2)
ln = Line(StartPoint=dispatch.ListA, EndPoint=dispatch_2.ListA)
ln_2 = Line(StartPoint=move_5.Geometry, EndPoint=move_8.Geometry)
move_10 = Move(Geometry=boundary_2, Motion=X_4)  # -> Geometry, Transform
move_11 = Move(Geometry=boundary_3, Motion=Y_4)  # -> Geometry, Transform
merge_2 = Merge(Data1=move_11.Geometry, Data2=boundary_3, Data3=boundary, Data4=boundary_2, Data5=move_10.Geometry)
join = BrepJoin(Breps=merge_2)  # -> Breps, Closed
