# Grasshopper definition shot.gh (Grasshopper 1.0.4)

pt = Point(Point(0, 0, 0))
number_slider = Slider(20, range=0..100)
cluster = Cluster(
    P_2=pt,
    R_2=Slider(1.1, range=0..10),
    A_2=Slider(4, range=0..10),
    B_2=number_slider,
    A=number_slider,
    B=Slider(1, range=0..1),
    P=pt,
    R=Slider(0.995, range=0..1),
    P_3=pt,
    F=Slider(0.25, range=0..1))

# ==== cluster Cluster
A = ClusterInput()
B = ClusterInput()
A_2 = ClusterInput()
B_2 = ClusterInput()

addition = Addition(A=A, B=B)
division = Division(A=A_2, B=B_2)
series = Series(Start=0, Step=division, Count=addition)
Z = UnitZ(Factor=series)

P = ClusterInput()
R = ClusterInput()

cir = Circle(Plane=P, Radius=R)
move = Move(Geometry=cir, Motion=Z)  # -> Geometry, Transform
shift = ShiftList(List=move.Geometry, Shift=Slider(3, range=0..10), Wrap=Toggle(False))
rev = ReverseList(List=shift)

P_2 = ClusterInput()
R_2 = ClusterInput()
P_3 = ClusterInput()
F = ClusterInput()

cir_2 = Circle(Plane=P_3, Radius=Slider(0.001, range=0..0.001))
Z_2 = UnitZ(Factor=F)
move_2 = Move(Geometry=cir_2, Motion=Z_2)  # -> Geometry, Transform

cir_3 = Circle(Plane=P_2, Radius=R_2)
move_3 = Move(Geometry=cir_3, Motion=Z)  # -> Geometry, Transform

merge = Merge(Data1=move_3.Geometry, Data2=rev, Data3=move_2.Geometry)
loft = Loft(Curves=flatten(merge), Options={Adjust=False, Closed=False, LoftEnds=0, LoftSimp=0, LoftType=0, Rebuild=10, Refit=0.01})
L = ClusterOutput(loft)
