# Grasshopper definition grid.gh (Grasshopper 1.0.4)

pt = Point(Point(0, 0, 0))
series = Series(Start=0, Step=1, Count=10)
lng = ListLength(List=series)
Y = UnitY(Factor=series)
X = UnitX(Factor=series)
move = Move(Geometry=pt, Motion=X)  # -> Geometry, Transform
move_2 = Move(Geometry=move.Geometry, Motion=graft(Y))  # -> flatten(Geometry), Transform
number_slider = Slider(-0.5, range=-0.5..0)
dom = ConstructDomain(DomainStart=Slider(-1, range=-1..0), DomainEnd=lng)
lng_2 = ListLength(List=move_2.Geometry)
rectangle = Rectangle(Plane=pt, XSize=dom, YSize=dom, Radius=0)  # -> Rectangle, Length
random = Random(Range=Domain(0, 1), Number=lng_2, Seed=2)
Z = UnitZ(Factor=Slider(-1, range=-1..0))
multiplication = Multiplication(A=random, B=Slider(3, range=0..10))
extr = Extrude(Base=rectangle.Rectangle, Direction=Z)
division = Division(A=random, B=Slider(3, range=0..10))
Z_2 = UnitZ(Factor=Slider(0.5, range=0..1))
cap = CapHoles(Brep=extr)
move_3 = Move(Geometry=cap, Motion=Z_2)  # -> Geometry, Transform
Z_3 = UnitZ(Factor=multiplication)
subtraction = Subtraction(A=Slider(0.5, range=0..1), B=division)
move_4 = Move(Geometry=move_2.Geometry, Motion=Z_3)  # -> Geometry, Transform
ln = Line(StartPoint=move_2.Geometry, EndPoint=move_4.Geometry)
pipe = Pipe(Curve=ln, Radius=subtraction, Caps=0)
cap_2 = CapHoles(Brep=pipe)
